# Dynamo graph Algoritmo-do-projeto-computacional-da-Viga.dyn "Viga Simples V28" (Dynamo 2.5.0.7460)
# packages: GenerativeDesign 1.1.0, Dynamo for Rebar 2.0.2

code_block = CodeBlock()
# ---------- code_block.designscript (6 lines) ----------
L1 = ["Vigas", "V1","V2", "V3"];
L2 = ["g", 30, 50, 20];
L3 = ["q", 20, 60, 10];
L4 = ["M1",50, 150, 250];
L5 = ["M2", 100, 150,250];
excel = [L1, L2, L3, L4, L5];
# ----------------------------------------

# group: Geração
bw = DoubleSlider(0.85, range=0..1 step 0.01)  # graph input
h = DoubleSlider(0.39, range=0..1 step 0.01)  # graph input
dlong = DoubleSlider(7, range=3..9 step 1)  # graph input
dest = DoubleSlider(3, range=0..3 step 1)  # graph input
diâmetros_armadura = CodeBlock(Dlong=dlong, Dest=dest) { diametros=[4.2,5.0,6.0,8.0,10.0,12.5,16.0,20.0,25.0,32.0]; diametros[Dlong]; diametros[Dest]; }
dlong_2 = Watch(diâmetros_armadura.out1)
dest_2 = Watch(diâmetros_armadura.out2)
fck_em_mpa = DoubleSlider(40, range=20..45 step 5)  # graph input

# group: Restrições
selecionar_face_vertical = DSFaceSelection()  # "Selecionar face vertical esquerda"; 1 picked in the model; graph input
selecionar_face_vertical_direita = DSFaceSelection()  # 1 picked in the model; graph input
distanceTo = Geometry.DistanceTo(geometry=selecionar_face_vertical, other=selecionar_face_vertical_direita)
firstItem = List.FirstItem(list=distanceTo)
remember = Data.Remember(firstItem)
# note: Restrições:
# 1 - Restrição vertical fixa
# 2 - Restrição vertical livre
# 3 e 4 - Restrições horizontais
selecionar_face_horizontal_fixa = DSFaceSelection()  # 1 picked in the model; graph input
selecionar_face_horizontal_livre = DSFaceSelection()  # 1 picked in the model; graph input
distanceTo_2 = Geometry.DistanceTo(geometry=selecionar_face_horizontal_fixa, other=selecionar_face_horizontal_livre)
firstItem_2 = List.FirstItem(list=distanceTo_2)
remember_2 = Data.Remember(firstItem_2)

code_block_2 = CodeBlock(ib=bw, bmax=remember, ih=h, hmax=remember_2) { bw=Math.Round(0.14+ib*(bmax-0.14),2); h=Math.Round(0.26+ih*(hmax-0.14),2); }

# group (continued): Geração
bw_2 = Watch(code_block_2.bw)
h_2 = Watch(code_block_2.h)

# group: Condições do projeto
cobrimento_cm = DoubleInput(2)
ca_50_fyk_long_mpa = DoubleInput(500)
# note: Brita 0 - 9,5 mm
# Brita 1 - 19,0 mm
# Brita 2 - 25,0 mm
# Brita 3 - 50,0 mm
dagregado_mm = DoubleInput(19)
ca_60_fyk_transv_mpa = DoubleInput(600)

# group: Informações da Viga
selecione_a_viga = DSModelElementSelection()  # 1 picked in the model; graph input
code_block_3 = CodeBlock { "Comprimento"; }
getParameterValueByName = Element.GetParameterValueByName(element=selecione_a_viga, parameterName=code_block_3)
remember_3 = Data.Remember(getParameterValueByName)
elementType = Element.ElementType(element=selecione_a_viga)
code_block_4 = CodeBlock { "Nome do tipo"; }
getParameterValueByName_2 = Element.GetParameterValueByName(element=elementType, parameterName=code_block_4)
remember_4 = Data.Remember(getParameterValueByName_2)

# group: Importação do Excel
file_path = Filename("..\..\Excel\Cargas TCC.xlsx")
file_from_path = FileObject(path=file_path)
code_block_5 = CodeBlock { "Cargas"; false; true; }
importExcel = Data.ImportExcel(file=file_from_path, sheetName=code_block_5.out0, readAsStrings=code_block_5.out1, showExcel=code_block_5.out1)
remember_5 = Data.Remember(importExcel)

# group: Cargas
code_block_6 = CodeBlock(excel=remember_5, v=remember_4, bw=bw_2, h=h_2)
# ---------- code_block_6.designscript (8 lines) ----------
i=List.FirstIndexOf(excel[0],v);
g1=bw*h*25;
g2=excel[1][i];
g=g1+g2;
q=excel[2][i];
P=g+q;
M1=excel[3][i];
M2=excel[4][i];
# ----------------------------------------

# group: Solicitações
# note: Momento em (kN.m)
code_block_7 = CodeBlock(P=code_block_6.P, L=remember_3, M1=code_block_6.M1, M2=code_block_6.M2)
# ---------- code_block_7.designscript (8 lines) ----------
Va = P*L/2+M1/L-M2/L;
Vb = P*L/2-M1/L+M2/L;
Vmax = Math.Max(Va,Vb);
xv0 = Va/P;
Mpos = Va*xv0-P*xv0*xv0/2-M1;
Mneg1 = M1;
Mneg2 = M2;
Cargas = [M1,Mpos,M2];
# ----------------------------------------

calculo_das_seções = Python(IN[0]=bw_2, IN[1]=h_2, IN[2]=cobrimento_cm, IN[3]=remember_3, IN[4]=dlong_2, IN[5]=dest_2, IN[6]=fck_em_mpa, IN[7]=ca_50_fyk_long_mpa, IN[8]=dagregado_mm, IN[9]=code_block_7.Cargas)
# ---------- calculo_das_seções.python (202 lines) ----------
# Carregar as bibliotecas DesignScript e padrão do Python
import sys
import clr
clr.AddReference('ProtoGeometry')
from Autodesk.DesignScript.Geometry import *
import math as mt

# ENTRADAS #
#Geométricos
bw = IN[0] # Dimensão Base do pilar (m)
h = IN[1] # Dimensão Altura do pilar (m)
c = IN[2]/100.0 # Cobrimento do concreto (m)
L = IN[3] # Comprimento da Viga (m)
# Armadura
dlong = IN[4]/1000.0 # Diâmetro da Armadura (m)
dest = IN[5]/1000.0 # Diâmetro do Estribo (m)
 #Materiais
fck = IN[6] # fck em (MPa)
fyk = IN[7] # fyk em (MPa)
fcd = fck/1.4*1000000.0 # fcd em (Pa)
fyd = fyk/1.158*1000000.0 # Tensão de escoamento do aço (Pa)
dagreg = IN[8]/1000.0 # Diâmetro máximo do Agregado (m)
# Solicitações
Cargas = IN[9] # lista com as cargas
M1 = Cargas[0] # Momento no ponto 1 (kNm)
Mpos = Cargas[1] # Momento max no meio (kNm)
M2 = Cargas[2] # Momento no ponto 2 (kNm)
Mdneg1 = M1*1.4*1000 # Momento de Calculo Negativo 1 (Nm)
Mdpos = Mpos*1.4*1000 # Momento de Calculo positivo max (Nm)
Mdneg2 = M2*1.4*1000 # Momento de Calculo Negativo 2 (Nm)

# MEDIDAS IMPORTANTES
# d e d'
dl = c+dest+1.04*dlong/2 # Mossa da armadura 0,04 (m)
d = h-dl # (m)

# Espaçamentos
diamcomfusco = 1.04*dlong # 0.04 saliência da mossa do ferro (m)
ah = max(0.02,diamcomfusco,1.2*dagreg) # Espaçamento entre as barras horizontal (m)
av = max(0.02,diamcomfusco,0.5*dagreg) # Espaçamento entre as barras vertical (m)
sh = ah+diamcomfusco # Espaçamento entre eixos de barras horizontal minimo (m)
sv = av+diamcomfusco # Espaçamento entre eixos de barras vertical minimo (m)
slivrex = bw-2*dl # Espaço livre para colocação das barras em x (m)
slivrey = h-2*dl # Espaço livre para colocação das barras em y (m)


#FUNÇÕES DE DIMENSIONAMENTO

def calculoAs(bw, d, c, fcd, fyd, Md) : # calculo de As 
	if fcd <= 50*1000000/1.4: # fck<50
		gama = 0.8 # Gama e alphac diferentes com o fck
		alphac = 0.85
	else : # fck>50 gama e alphac obedecem a formula
		gama = 0.8-(fcd*1.4/1000000-50)/400 
		alphac = 0.85*(1-(fcd*1.4/1000000-50)/200)
	KMD = Md/(bw*d*d*fcd)
	KX = (1-(1-2*KMD/alphac)**0.5)/gama # KX = x/d
	KZ = 1-gama*KX/2
	As = Md/(KZ*d*fyd) # As 
	return As, KX

# DETALHAMENTO DA SEÇÃO

def detalhamento(bw, h, dlong, dl, As, slivrex, slivrey, sh, sv): # Posiciona as barras na parte inferior da viga
	x1 = -bw/2+dl # Coordenadas com origem no canto inferior esquerdo da seção da viga
	x2 = bw/2-dl
	y = -h/2+dl
	nbar = round(As/((mt.pi*dlong**2.0)/4)) # Numero de barras para resistir ao esforço
	if nbar<(As/((mt.pi*dlong**2.0)/4)): # Se arredondou para baixo soma +1
		nbar=nbar+1 # Numero de barras para resistir ao esforço numero inteiro
	if nbar>2: # Se vai ter mais de duas barras vamos entrar na função distribuição
		pn=[]
		pn, ncamadas, nbx =distribuicao(pn, x1, x2, y, nbar, slivrex, slivrey, sh, sv)
	else:
		nbar=2
		pn=[[x1,y],[x2,y]] # No caso de ter só 2 barras
		ncamadas=1
		nbx=2 # Numero de barras na primeira camada
	px=[]
	py=[]
	for i in range(len(pn)):
		px.append(pn[i][0]) # Lista com as coordenadas x das barras (seguindo o sistema comentado anteriormente)
		py.append(pn[i][1]) # Lista com as coordenadas y das barras
	Asreal=nbar*((mt.pi*(dlong)**2.0)/4)
	return px, py, ncamadas, Asreal, nbar, nbx 
# Esse esta dentor do detalhamento
def distribuicao(pn, x1, x2, y, nbar, slivrex, slivrey, sh, sv): # Distribuição com mais de 2 barras
	nbx = round(slivrex/sh) # Número de barras que cabe em slivrex (ou seja na primeira camada) Obs.: é o que cabe não o que vai ter
	if nbx<(slivrex/sh):
		nbx = nbx+1 # Arredonda para cima pq nbx é numero de barras não de espaços, entendeu ?
	ncamadas = (nbar-nbx)/2+1 # Numero de camadas
	if ncamadas<=1:
		ncamadas = 1
	ncamadas = round(ncamadas+0.1) # Arredondar para cima sempre uma vez que ncamadas é multiplo de 0.5
	nbarf = nbar # Numero de barras que falta posicionar
	ncamadasf = ncamadas # Numero de camadas que falta posicionar
	if nbar<nbx:
		nbx = nbar # nbx precisa ser a partir daqui o numero de barras na 1ª camada
	sxreal = slivrex/(nbx-1) # Espaçamento em x real entre as barras 
	for i in range(int(nbx)): # Esse 'for' posiciona as barras na primeira camada
		pn.append([x1+sxreal*(i),y])
	ncamadasf = ncamadas-1
	nbarf=nbarf-nbx
	while nbarf>0:
		if nbarf==1:
			pn.append([x1,y+(ncamadas-ncamadasf)*sv]) # Posiciona barra única no canto esquerdo
			break # Se só tinha uma barra pode acabar o laço
		else:
			pn.append([x1,y+(ncamadas-ncamadasf)*sv]) # Posiciona barra a esquerda na camada
			pn.append([x2,y+(ncamadas-ncamadasf)*sv]) # Posiciona barra a direita na camada
			nbarf=nbarf-2
		ncamadasf=ncamadasf-1
		nbarf=nbarf-2
		if ncamadasf==0:
			break
	return pn, ncamadas, nbx

# VERIFICAÇÕES

def calcdreal(h, dl, nbx, nbar, sv):
	ncamadas = (nbar-nbx)/2+1 # Numero de camadas dessa vez não arredondei
	sy = 0
	for i in range(int(round(ncamadas+0.1))):
		sy = sy + 2*i*sv # 2 barras i*sv é a distancia
		t=i
	if (ncamadas%1)==0: # Caso
		sy = sy
	else :
		sy = sy-t*sv
	ycg = sy/nbar
	dreal = h-dl-ycg
	return dreal, ycg
# Calculo de As minimo
def calcAsmin(fck, bw, h):
	tabelaro = [0.15, 0.15, 0.15, 0.164, 0.179, 0.194, 0.208, 0.211, 0.219, 0.226, 0.233, 0.239, 0.245, 0.251, 0.256] 
	i = (fck-20)/5 # Tabela acima começa do fck 20 e segue de 5 em 5
	romin = tabelaro[int(i)]
	Asmin = romin/100*bw*h # As minimo em (m²)
	return Asmin
# Verificar As maximo
def CalcAsmax(bw, h, Asreal, Asmin):
	Asmax = 0.04*bw*h -Asmin # As maximo em (m²)
	return Asmin
# Verificações geometricas
def verifgeo(ncamadas, slivrey, sv, slivrex, sh):
	check = 0
	if ncamadas*sv > 0.5*slivrey: # Verificar se não tem camadas demais para o numero de camadas cabe na seção
		check = -1 # Camadas demais
	if slivrex<sh:	# Verificar se cabe mais de uma barra na camada horizontal
		check = -1
	return check
# Verificação da Consideração de Armadura Concentrada
def ArmConcen(ycg, h):
	check = 0
	if ycg>0.1*h:
		check = -1
	return check

def calculo(d, bw, c, fcd, fyd, Md, fck, h, dlong, dl, slivrex, slivrey, sh, sv): #Dimensionamento definitivo
	dadot = d
	cont = 0
	check = 0
	Asmin = calcAsmin(fck, bw, h)
	Asmax = 0.04*bw*h-((mt.pi*dlong**2.0)/4)*2
	while True: # Considera o d inicial depois atuailza conforme o CG da armadura muda
		As, KX = calculoAs(bw, dadot, c, fcd, fyd, Md)
		if As<Asmin and As>0:
			As = Asmin
		px, py, ncamadas, Asreal, nbar, nbx = detalhamento(bw, h, dlong, dl, As, slivrex, slivrey, sh, sv) # Detalhamento 
		dreal, ycg = calcdreal(h, dl, nbx, nbar, sv) # calcula o centro de massa da armadura para calcular o dreal
		if dreal<dadot:
			dadot = dreal
		if dreal>=dadot: # Se for isso da ok
			Checkdreal = 0
			break
		if cont ==1000:  # para segraça caso não tenha convergencia
			Checkdreal = -1
			break
		cont = cont+1
	TxAs = (Asreal-Asmin)/(Asmax - Asmin)
	dmin =2*(Md/bw/fcd)**0.5
	Txd = dmin/dreal
	TxAC = ycg/0.1*h
	CheckGeo = verifgeo(ncamadas, slivrey, sv, slivrex, sh)
	CheckConcen = ArmConcen(ycg, h)
	if CheckGeo==-1 or CheckConcen==-1 or Checkdreal==-1:
		check = -1
	return px, py, check, KX, dreal, TxAs, Txd, TxAC

pxneg1, pyneg1, checkneg1, KXneg1, drealneg1, TxAsneg1, Txdneg1, TxACneg1 = calculo(d, bw, c, fcd, fyd, Mdneg1, fck, h, dlong, dl, slivrex, slivrey, sh, sv)
pxpos, pypos, checkpos, KXpos, drealpos, TxAspos, Txdpos, TxACpos = calculo(d, bw, c, fcd, fyd, Mdpos, fck, h, dlong, dl, slivrex, slivrey, sh, sv)
pxneg2, pyneg2, checkneg2, KXneg2, drealneg2, TxAsneg2, Txdneg2, TxACneg2 = calculo(d, bw, c, fcd, fyd, Mdneg2, fck, h, dlong, dl, slivrex, slivrey, sh, sv)

def invert(py): #Coreção do eixo z nas armaduras negativas 
	for i in range(len(py)):
		py[i]=-py[i]
	return py

pyneg1 = invert(pyneg1)
pyneg2 = invert(pyneg2)

OUT = [pxneg1, pyneg1, checkneg1, KXneg1, drealneg1, TxAsneg1, Txdneg1, TxACneg1], [pxpos, pypos, checkpos, KXpos, drealpos, TxAspos, Txdpos, TxACpos], [pxneg2, pyneg2, checkneg2, KXneg2, drealneg2, TxAsneg2, Txdneg2, TxACneg2]
# ----------------------------------------

# group: Verificações ELS
verificação_do_els = Python(IN[0]=bw_2, IN[1]=h_2, IN[2]=cobrimento_cm, IN[3]=remember_3, IN[4]=dlong_2, IN[5]=dest_2, IN[6]=fck_em_mpa, IN[7]=ca_50_fyk_long_mpa, IN[8]=dagregado_mm, IN[9]=code_block_6.g, IN[10]=code_block_6.q, IN[11]=calculo_das_seções)
# ---------- verificação_do_els.python (77 lines) ----------
# Carregar as bibliotecas DesignScript e padrão do Python
import sys
import clr
clr.AddReference('ProtoGeometry')
from Autodesk.DesignScript.Geometry import *
import math as mt

# ENTRADAS #
#Geométricos
bw = IN[0] # Dimensão Base do pilar (m)
h = IN[1] # Dimensão Altura do pilar (m)
c = IN[2]/100.0 # Cobrimento do concreto (m)
l = IN[3] # Comprimento da Viga (m)
# Armadura
dlong = IN[4]/1000.0 # Diâmetro da Armadura (m)
dest = IN[5]/1000.0 # Diâmetro do Estribo (m)
#Materiais
fck = IN[6] # fck em (MPa)
fyk = IN[7] # fyk em (MPa)
fctm = 0.3*fck**(2.0/3.0) #(MPa)
dagreg = IN[8]/1000.0 # Diâmetro máximo do Agregado (m)
#Cargas
g = IN[9] #(kNm)
q = IN[10] #(kNm)
#Lista do'calculo da seção'
d = IN[11][1][4] # (m)
nbar = len(IN[11][1][0]) # Numero de barras da positiva
# Saber qual seção coom barra externa mais próxima a LN
lista = [abs(-IN[11][0][4]*IN[11][0][3]+IN[11][0][1][-1]+h/2), abs(-IN[11][1][4]*IN[11][1][3]-IN[11][1][1][-1]+h/2), abs(-IN[11][2][4]*IN[11][2][3]+IN[11][2][1][-1]+h/2)]
minlist = min(lista)
for i in range(3):
	if minlist == lista[i]:
		break
ah = abs(IN[11][i][0][-1]-IN[11][i][0][-2]) #Esta na Lista i a barra

# ABERTURA CARACTERISTICA DE FISSURA

ssi = fyk/(1.4*1.15)*(g+0.4*q)/(g+q) #(MPa)
aa = c + dest + dlong*1.04/2 # (m)
b = ah/2 # (m)
if IN[11][i][1][-1] == h/2-aa or IN[11][i][1][-1] == -h/2+aa : # Se tiver só uma camada c é aa
	av = aa
	c = av
else:
	av = max(0.02,dlong*1.04,0.5*dagreg) # Espaçamento entre as barras vertical (m)
	c = av/2 # (m)
dd = 7.5*dlong # (m)
Acri = (aa+b)*(c+dd) # (m²)
As = 3.1415*dlong**2/4 # (m²)
rcri = As/Acri # S/U

wk1 = dlong/(12.5*2.25)*ssi/210000*(3*ssi/fctm) # (m)
wk2 = dlong/(12.5*2.25)*ssi/210000*(4/rcri+45) # (m)
wk = min(wk1,wk2) # (m)

# DEFORMAÇÃO EXCESSIVA IMEDIATA

P = g+0.3*q # Combinação quase permanente (kNm)
Ic = bw*h**3/12 #(m^4)
Ecs = min((0.8+0.2*fck/80),1)*5600*(fck)**(0.5) # (MPa)
alpe = 210000/Ecs # S/U
a1 = bw/2 # (m)
a2 = alpe*nbar*As # (m²)
a3 = -d*a2 # (m³)
xii = (-a2+(a2**2-4*a1*a3)**(0.5))/(2*a1) # (m)
Iii = bw*xii**3/12+alpe*nbar*As*(xii-d)**2 # (m^4)
Mr = 1.5*fctm*1000*Ic/(h/2) # (kNm)
Ma = (P*l**2)/8 # (kNm)
Im = (Mr/Ma)**3*Ic+(1-(Mr/Ma)**3)*Iii # (m^4)

a = 5*P*l**4/(384*Im*Ecs)/1000 # (m)

# DEFORMAÇÃO EXCESSIVA DEFERIDA NO TEMPO

at = a*(2.39505)

OUT = wk, a, at
# ----------------------------------------
code_block_8 = CodeBlock(s=verificação_do_els) { wk =s[0]; a = s[1]; at = s[2]; }
wt = Watch(code_block_8.wk)  # graph output
a = Watch(code_block_8.a)  # graph output
at = Watch(code_block_8.at)  # graph output

dimenssionamento_de_Viga_TCC = Custom[Dimenssionamento_de_Viga_TCC](bw=bw_2, h=h_2, c=cobrimento_cm, L=remember_3, dlong=dlong_2, dest=dest_2, fck=fck_em_mpa, fyk=ca_50_fyk_long_mpa, dagreg=dagregado_mm, cargas=code_block_7.Cargas, g=code_block_6.g, q=code_block_6.q, Vmax=code_block_7.Vmax, P=code_block_6.P, Va=code_block_7.Va, fykt=ca_60_fyk_transv_mpa)  # frozen; Dimenssionamento de Viga
comprimentos_de_ancoragem = Python(IN[0]=calculo_das_seções, IN[1]=code_block_7.Cargas, IN[2]=code_block_7.Vmax, IN[3]=bw_2, IN[4]=fck_em_mpa, IN[5]=ca_50_fyk_long_mpa, IN[6]=dlong_2, IN[7]=remember_3, IN[8]=code_block_6.P, IN[9]=code_block_7.Va)
# ---------- comprimentos_de_ancoragem.python (108 lines) ----------
# Carregar as bibliotecas DesignScript e padrão do Python
import sys
import clr
clr.AddReference('ProtoGeometry')
from Autodesk.DesignScript.Geometry import *
import math as mt

cargas = IN[1] # [M1,Mpos,M2] em (kNm)
Vmax = IN[2] # Cortante máxima (kN)
bw = IN[3] # (m)
fck = IN[4] # (MPa)
fyk = IN[5] # (Mpa)
dlong = IN[6]/1000 # (m)
L = IN[7] # (m)
d = min(IN[0][0][4], IN[0][1][4], IN[0][2][4]) # usa a altura útil minima para o calculo de Vc (m)


fctd = 0.15*(fck)**(2.0/3.0) # (kN)
fbd = 2.25*fctd # (MPa)
Vc = 0.6*fctd*bw*d*1000 # (kN)
al = d*(Vmax*1.4/(2*(Vmax*1.4-Vc)))
if al<0.5*d:
	al = 0.5*d
if al>d:
	al = d
# COMPRIMENTOS DE ANCORAGEM
lb = dlong/4*fyk/1.15/fbd # comprimento de ancoragem reto básico (m)
lbgancho = 0.7*lb #comprimento de ancoragem com gancho (m)
ad = al + lb # comprimento a acrescentar a barras sem gancho
e = dlong*3.5
# Comprimento das barras 

P = IN[8]
Va = IN[9]
M1 = cargas[0]
M2 = cargas[2]
a = -P/2
b = Va
c = -M1
x1 = (-b+(b**2-4*a*c)**(0.5))/(2*a)
x2 = (-b-(b**2-4*a*c)**(0.5))/(2*a)

#comprimentos da armadura negativa (superior)
psi1 = 0 + e # ponto superior de inicio do trecho 1 
psf1 = x1 + ad # ponto superior de fim do trecho 1
if M1 == 0: # Nesse caso não fazemos essa seção
	psf1 = 0 + e+0.025 # não pode zerar o comprimento do cilindro
psi3 = x2 - ad
if M2==0:
	psi3 = L - e -0.025 # não pode zerar o comprimento do cilindro
psf3 = L - e
if psf1>=psi3: # as barras de um lado chegam no outro lado
	if psf1>=L-e: # condição que a ancoragem sai da viga
		psf1=L-e
		psi3=psf1+0.025
		psf3=psi3+0.025
	elif psi3<=0+e:
		psi3=0+e
		psf1=psi3-0.025
		psi1=psf1-0.025
	elif len(IN[0][0][0])>=len(IN[0][2][0]): # se tiver mais barras no lado 1 
		psi3 = psf1+0.025 # Barras do lado 1 prevalecem 
	elif len(IN[0][0][0])<len(IN[0][2][0]):
		psf1 = psi3-0.025
psi2 = psf1
psf2 = psi3

#comprimentos da armadura positiva (inferior)
pii1 = 0 + e # ponto inferior de inicio do trecho1
pii2 = x1 - ad
if pii2<0+e:
	pii2 = 0 + e
pif1 = pii2
pif2 = x2 + ad
if pif2>L-e:
	pif2 = L - e
pii3 = pif2
pif3 = L - e
if pii1==pif1:
	pii1=pii1-0.025
if pii3==pif3:
	pif3=pif3+0.025

pi = []
pf = []
# Pontos inicial e final
#superior
for i in range(len(IN[0][0][0])): # de M1
	pi.append(psi1)
	pf.append(psf1)
for i in range(2): # da armadura de sustentação
	pi.append(psi2)
	pf.append(psf2)
for i in range(len(IN[0][2][0])): # de M2
	pi.append(psi3)
	pf.append(psf3)
#inferior
for i in range(2): # da armadura de sustentação
	pi.append(pii1)
	pf.append(pif1)
for i in range(len(IN[0][1][0])): # de Mpos
	pi.append(pii2)
	pf.append(pif2)
for i in range(2): # da armadura de sustentação
	pi.append(pii3)
	pf.append(pif3)

OUT = pi, pf
# ----------------------------------------
s_da_armadura_transversal = Python(IN[0]=code_block_7.Vmax, IN[1]=calculo_das_seções, IN[2]=bw_2, IN[3]=fck_em_mpa, IN[4]=ca_60_fyk_transv_mpa, IN[5]=dest_2)
# ---------- s_da_armadura_transversal.python (52 lines) ----------
# Carregar as bibliotecas DesignScript e padrão do Python
import sys
import clr
clr.AddReference('ProtoGeometry')
from Autodesk.DesignScript.Geometry import *
import math as mt

Vmax = IN[0] # (kN)
d = min(IN[1][0][4],IN[1][1][4],IN[1][2][4]) # (m)
bw = IN[2] # (m)
fck = IN[3] # (MPa)
fyk = IN[4] # (MPa)
dest = IN[5]/1000.0 # (m)

check = 0

Tsd = (1.4*Vmax)/bw/d/1000.0 # (MPa)
Trd2i = 0.27*(1-fck/250)*fck/1.4 # (MPa)
TxT = Tsd/Trd2i

Tsw = Tsd-0.09*(fck)**(2.0/3.0) # (MPa)
fywd = fyk/1.15 # (MPa)
rsw = (1.11*Tsw)/(fywd) # S/N
rswmin = 0.06*(fck)**(2.0/3.0)/fyk # S/N
#Espaçamento dos estribos
s = 2*(3.1415*dest**2/4)/rsw/bw  # (m)
#Armadura minima (espaçamento maximo)
smax = 2*(3.1415*dest**2/4)/rswmin/bw  # (m)
if s > smax:
	s = smax
#espaçamento maximo em função do esforço cortante
Vsd = Vmax*1.4
Vrd2 = Trd2i*bw*d
if Vsd <= 0.67*Vrd2:
	smax = 0.6*d
	if smax>0.3:
		smax = 0.3
if Vsd > 0.67*Vrd2:
	smax = 0.3*d
	if smax>0.2:
		smax = 0.2
if s > smax:
	s = smax

checkneg1 = IN[1][0][2]
checkpos = IN[1][1][2]
checkneg2 = IN[1][2][2]

if checkneg1 == -1 or checkpos ==-1 or checkneg2==-1:
	check = -1

OUT = s, check, TxT
# ----------------------------------------
code_block_9 = CodeBlock(c=cobrimento_cm, dest=dest_2, dlong=dlong_2, bw=bw_2, h=h_2, IN=calculo_das_seções, INx=comprimentos_de_ancoragem, checkf=s_da_armadura_transversal)
# ---------- code_block_9.designscript (9 lines) ----------
dl = c/100.0+dest/1000.0+dlong/2*1.04/1000.0;
ys = [-bw/2+dl,bw/2-dl];
zs = [h/2-dl,h/2-dl];
zi = [-h/2+dl,-h/2+dl];
py=List.Join([IN[0][0], ys , IN[2][0], ys, IN[1][0], ys]);
pz=List.Join([IN[0][1], zs , IN[2][1], zi, IN[1][1], zi]);
pxi=INx[0];
pxf=INx[1];
check = [[IN[0][5], IN[1][5], IN[2][5]], [IN[0][3], IN[1][3], IN[2][3]], [IN[0][6], IN[1][6], IN[2][6]], [IN[0][7], IN[1][7], IN[2][7]], checkf[2] ,checkf[1]];
# ----------------------------------------
code_block_10 = CodeBlock(l=remember_3) { Point.ByCoordinates(0.0,0.0,-[l/2]); }
geo_arm_transv = Python(IN[0]=bw_2, IN[1]=h_2, IN[2]=remember_3, IN[3]=cobrimento_cm, IN[4]=dest_2, IN[5]=s_da_armadura_transversal, IN[6]=code_block_10)
# ---------- geo_arm_transv.python (59 lines) ----------
# Carregar as bibliotecas DesignScript e padrão do Python
import sys
import clr
clr.AddReference('ProtoGeometry')
from Autodesk.DesignScript.Geometry import *
from math import cos
from math import sin
from math import radians

# As entradas para este nó serão armazenadas como uma lista nas variáveis IN.

b = [IN[0]]
h = [IN[1]]
lp = [IN[2]]
c = [float(IN[3])]
dt = [IN[4]]
st = [IN[5][0]*100]
dg = [0]
pbase = IN[6]

# Insira o código abaixo desta linha
	
estribos=[]
for i in range(len(dt)):
	rmin=3*(dt[i]/1000) #raio da dobra
	gn=max(4*dt[i]/1000,0.05) #Comprimento do gancho
	cob0=c[i]/100+dt[i]/2000
	cob1=cob0+rmin
	x0=cob0
	x1=cob1
	x2=b[i]-cob1
	x3=b[i]-cob0
	y0=cob0
	y1=cob1
	y2=h[i]-cob1
	y3=h[i]-cob0
	plx=[(x1+rmin*cos(radians(135)))+gn*cos(radians(45)),x1+rmin*cos(radians(135)), x1, x1,x2, x2, x3,x3, x2, x2,x1, x1, x0,x0, x1, x1-rmin*cos(radians(135)),(x1-rmin*cos(radians(135)))+gn*cos(radians(45))]
	ply=[(y1+rmin*sin(radians(135)))+gn*cos(radians(45)),y1+rmin*sin(radians(135)), y1, y0,y0, y1, y1,y2, y2, y3,y3, y2, y2,y1, y1, y1-rmin*sin(radians(135)),(y1-rmin*sin(radians(135)))+gn*cos(radians(45))]
	
	estribo=[]
	for j in range(1,int(lp[i]/(st[i]/100))+1,1):
		p = []
		for k in range(len(plx)):
			ax=plx[k]-b[i]/2
			ay=ply[k]-h[i]/2
			u=(ax*cos(radians(dg[i]))-ay*sin(radians(dg[i])))
			v=(ax*sin(radians(dg[i]))+ay*cos(radians(dg[i])))
			p.append(Point.ByCoordinates(pbase[i].Z+j*st[i]/100,u+pbase[i].X,v+pbase[i].Y))
		curvas=[]
		for l in range(0,len(p)+1,3):
			curvas.append(Line.ByStartPointEndPoint(p[l],p[l+1]))
			if l+3<len(p):
				curvas.append(Arc.ByCenterPointStartPointEndPoint(p[l+2],p[l+1],p[l+3]))
		estribo.append(PolyCurve.ByJoinedCurves(curvas,0.001))
	estribos.append(estribo)
	
	
# Atribua a sua saída para a variável OUT.
OUT = estribos
# ----------------------------------------

# group: Visualização
code_block_11 = CodeBlock(dlong=dlong_2, pxi=code_block_9.pxi, L=remember_3, py=code_block_9.py, pz=code_block_9.pz, pxf=code_block_9.pxf, bw=bw_2, h=h_2)
# ---------- code_block_11.designscript (5 lines) ----------
r = dlong/1000.0/2.0;
pi = Point.ByCoordinates(pxi-L/2,py,pz);
pf = Point.ByCoordinates(pxf-L/2,py,pz);
Cylinder.ByPointsRadius(pi,pf,r);
Cuboid.ByLengths(L, bw, h);
# ----------------------------------------
code_block_12 = CodeBlock(viga=code_block_11.out4, barra=code_block_11.out3, estribos=geo_arm_transv)
# ---------- code_block_12.designscript (6 lines) ----------
corviga=Color.ByARGB(150,200,200,200);
corbarra=Color.ByARGB(255,255,0,0);
corest=Color.ByARGB(255,10,10,10);
GeometryColor.ByGeometryColor(viga,corviga);
GeometryColor.ByGeometryColor(barra,corbarra);
GeometryColor.ByGeometryColor(estribos,corest);
# ----------------------------------------

# group: OUT detalhados
# note: Referência:
# de preço:
# aço CA-60:
# 04801/ORSE
# 04802/ORSE
# 04803/ORSE
# 04805/ORSE
# aço CA-50:
# 04795/ORSE
# 04796/ORSE
# 04797/ORSE
# 04798/ORSE
# 04800/ORSE
# 04799/ORSE
# 43057/SINAPI
# concreto:
# 00636/ORSE
# 00637/ORSE
# 02690/ORSE
# 00638/ORSE
# 02689/ORSE
# 08438/ORSE
# pesos das barras
# NBR 7480
code_block_13 = CodeBlock()
# ---------- code_block_13.designscript (7 lines) ----------
preçoCA60porkg = [8.32, 8.32, 8.32, 7.25];
preçoCA50porkg = [9.33, 8.80, 7.62, 7.62, 8.78, 8.78, 9.65];
CA60pesopormetro = [0.109, 0.154, 0.222, 0.395];
CA50pesopormetro = [0.395, 0.617, 0.963, 1.578, 2.466, 3.853, 6.313];
preçoCA60porm = preçoCA60porkg * CA60pesopormetro;
preçoCA50porm = preçoCA50porkg * CA50pesopormetro;
preçoconcreto = [319.53, 328.57, 339.52, 350.47, 365.60, 500.35];
# ----------------------------------------
code_block_14 = CodeBlock(b=bw_2, h=h_2, L=remember_3, f=code_block_9.pxf, i=code_block_9.pxi, estribos=geo_arm_transv, RSCA50=code_block_13.preçoCA50porm, idlong=dlong, RSCA60=code_block_13.preçoCA60porm, idest=dest, RSconc=code_block_13.preçoconcreto, ifck=fck_em_mpa)
# ---------- code_block_14.designscript (11 lines) ----------
Ac = b*h;
Af = b+2*h;
Pp =b*h*25*L;
complong = f-i;
comptlong = Sum(complong);
comptransv = Curve.Length(estribos);
compttransv = Sum(comptransv);
p1 = comptlong*RSCA50[idlong-3];
p2 = compttransv*RSCA60[idest];
p3 = b*h*L*RSconc[ifck/5-4];
preço = p1+p2+p3;
# ----------------------------------------
ac_m² = Watch(code_block_14.Ac)  # graph output
comp_arm_transv_m = Watch(code_block_14.compttransv)  # graph output
comp_arm_long_m = Watch(code_block_14.comptlong)  # graph output
área_de_forma_m² = Watch(code_block_14.Af)  # graph output
pp_kn = Watch(code_block_14.Pp)  # graph output
custo_r = Watch(code_block_14.preço)  # graph output

gate = Data.Gate(true, selecione_a_viga)

# group: Atualiza no Revit
nova_cor = ColorPalette({R: 255, G: 228, B: 225, A: 255})
code_block_15 = CodeBlock(vigaV=gate, cor=nova_cor, b=bw_2, h=h_2, c=cobrimento_cm, custo=custo_r)
# ---------- code_block_15.designscript (35 lines) ----------
vType = FamilyInstance.Type(vigaV);
cor;
b1=b;
h1=h;
c1=c;
custo;
//Parametros de tipo
pt1=vType.Parameters[0].Name;
 //b;
pt2=vType.Parameters[12].Name;
 //h;
pt3=vType.Parameters[7].Name;
 //custo;
//Parametros de instância
pi1=vigaV.Parameters[30].Name;
 //cobrimento;
pi2=vigaV.Parameters[31].Name;
 //cobrimento;
pi3=vigaV.Parameters[32].Name;
 //cobrimento;
updatevalues=[Imperative]{
if(vType!=null && vigaV!=null){
vType.SetParameterByName(pt1, b1);
vType.SetParameterByName(pt2, h1);
vType.SetParameterByName(pt3, custo);
//
vigaV.SetParameterByName(pi1, c1);
vigaV.SetParameterByName(pi2, c1);
vigaV.SetParameterByName(pi3, c1);
vigaV.OverrideColorInView(cor);
vType=null;
return "Atualizado!";
}else{return "Não atualizar!";
};
};
# ----------------------------------------

# group: Localização da armadura
getLocation = Element.GetLocation(element=selecione_a_viga)
remember_6 = Data.Remember(getLocation)
code_block_16 = CodeBlock(eLoc=remember_6) { p1=Line.StartPoint(eLoc); p2=Line.EndPoint(eLoc); }
code_block_17 = CodeBlock(p1=code_block_16.p1, p2=code_block_16.p2, c=cobrimento_cm, dlong=dlong_2, dest=dest_2)
# ---------- code_block_17.designscript (14 lines) ----------
pmx=(p1.X+p2.X)*0.5;
pmy=(p1.Y+p2.Y)*0.5;
dl=c/100+dlong*1.04/1000+dest/1000;
pmz=((p1.Z+p2.Z)*0.5)-0.4*0.5;
Point.ByCoordinates(pmx, pmy, pmz);
Vector.ZAxis();
dgf =[Imperative]{
if(p1.X!=p2.X){
dg=0;
return dg;
}else{dg = 90;
return dg;
};
};
# ----------------------------------------
byCoordinates = Vector.ByCoordinates(x=code_block_17.out0, y=code_block_17.out1, z=code_block_17.out3)
add = Point.Add(point=code_block_11.pi, vectorToAdd=byCoordinates)
add_2 = Point.Add(point=code_block_11.pf, vectorToAdd=byCoordinates)

# group: Inserir Vergalhão
byStartPointEndPoint = Line.ByStartPointEndPoint(startPoint=add, endPoint=add_2)
id = Element.Id(element=gate)
rebar_style = RebarStyle("Standard", EnumerationType="Autodesk.Revit.DB.Structure.RebarStyle, RevitAPI, Version=21.0.0.0, Culture=neutral, PublicKeyToken=null")
python_script = Python(IN[0]=dlong_2, IN[1]=ca_50_fyk_long_mpa)
# ---------- python_script.python (23 lines) ----------
# Carregar as bibliotecas DesignScript e padrão do Python
import sys
import clr
clr.AddReference('ProtoGeometry')
from Autodesk.DesignScript.Geometry import *

# As entradas para este nó serão armazenadas como uma lista nas variáveis IN.
d = IN[0]
fy= IN[1]

# Insira o código abaixo desta linha
if fy==250:
	tp="CA-25"
elif fy==500:
	tp="CA-50"
elif fy==600:
	tp="CA-60"
if d != round(d,0):
	rebar=str(d)+" "+tp
else:
	rebar=str(d).split(".")[0]+" "+tp
# Atribua a sua saída para a variável OUT.
OUT = rebar
# ----------------------------------------
byName = RebarBarType.ByName(name=python_script)
rebar_hook_orientation = RebarHookOrientation("Left", EnumerationType="Autodesk.Revit.DB.Structure.RebarHookOrientation, RevitAPI, Version=21.0.0.0, Culture=neutral, PublicKeyToken=null")
rebar_hook_type = RevitRebarHookType(ElementType="Autodesk.Revit.DB.Structure.RebarHookType, RevitAPI, Version=21.0.0.0, Culture=neutral, PublicKeyToken=null")  # nothing selected

rotate = Geometry.Rotate(geometry=byStartPointEndPoint, origin=code_block_17.out4, axis=code_block_17.out5, degrees=code_block_17.out6)

# group (continued): Inserir Vergalhão
normal = Curve.Normal(curve=rotate)
byCurve = Rebar.ByCurve(curve=rotate, hostElementId=id, rebarStyle=rebar_style, rebarBarType=byName, startHookOrientation=rebar_hook_orientation, endHookOrientation=rebar_hook_orientation, startHookType=rebar_hook_type, endHookType=rebar_hook_type, vector=normal)

# group: Inserir Vergalhão
translate = Geometry.Translate(geometry=geo_arm_transv, direction=byCoordinates)
id_2 = Element.Id(element=gate)
rebar_style_2 = RebarStyle("StirrupTie", EnumerationType="Autodesk.Revit.DB.Structure.RebarStyle, RevitAPI, Version=21.0.0.0, Culture=neutral, PublicKeyToken=null")
python_script_2 = Python(IN[0]=dest_2, IN[1]=ca_60_fyk_transv_mpa)  # same code as python_script
byName_2 = RebarBarType.ByName(name=python_script_2)
rebar_hook_orientation_2 = RebarHookOrientation("Right", EnumerationType="Autodesk.Revit.DB.Structure.RebarHookOrientation, RevitAPI, Version=21.0.0.0, Culture=neutral, PublicKeyToken=null")
rebar_hook_type_2 = RevitRebarHookType(ElementType="Autodesk.Revit.DB.Structure.RebarHookType, RevitAPI, Version=21.0.0.0, Culture=neutral, PublicKeyToken=null")  # nothing selected

rotate_2 = Geometry.Rotate(geometry=translate, origin=code_block_17.out4, axis=code_block_17.out5, degrees=code_block_17.out6)

# group (continued): Inserir Vergalhão
normal_2 = Curve.Normal(curve=rotate_2)
byCurve_2 = Rebar.ByCurve(curve=rotate_2, hostElementId=id_2, rebarStyle=rebar_style_2, rebarBarType=byName_2, startHookOrientation=rebar_hook_orientation_2, endHookOrientation=rebar_hook_orientation_2, startHookType=rebar_hook_type_2, endHookType=rebar_hook_type_2, vector=normal_2)

# group: Verificações no dimensionamento
code_block_18 = CodeBlock(IN=code_block_9.check)
# ---------- code_block_18.designscript (14 lines) ----------
v1=IN[0][0];
v2=IN[0][1];
v3=IN[0][2];
v4=IN[1][0];
v5=IN[1][1];
v6=IN[1][2];
v7=IN[2][0];
v8=IN[2][1];
v9=IN[2][2];
v10=IN[3][0];
v11=IN[3][1];
v12=IN[3][2];
v13=IN[4];
v14=IN[5];
# ----------------------------------------
taxa_as_neg1 = Watch(code_block_18.v1)  # graph output
taxa_as_pos = Watch(code_block_18.v2)  # graph output
taxa_as_neg2 = Watch(code_block_18.v3)  # graph output
kx_pos = Watch(code_block_18.v5)  # graph output
kx_neg1 = Watch(code_block_18.v4)  # graph output
kx_neg2 = Watch(code_block_18.v6)  # graph output
taxa_de_dmin_d_neg1 = Watch(code_block_18.v7)  # graph output
seção_invialvel = Watch(code_block_18.v14)  # graph output
taxa_tsd_trd2i = Watch(code_block_18.v13)  # graph output
taxa_de_dmin_d_pos = Watch(code_block_18.v8)  # graph output
taxa_de_dmin_d_neg2 = Watch(code_block_18.v9)  # graph output
taxa_arm_con_neg1 = Watch(code_block_18.v10)  # graph output
taxa_arm_con_neg2 = Watch(code_block_18.v12)  # graph output
taxa_arm_con_pos = Watch(code_block_18.v11)  # graph output
